# Grasshopper definition Cantilever.gh (Grasshopper 1.0.8)
# Copyright: hrntsm
# plug-ins: Lemur Info, IguanaMesh

brep = Brep(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)
number_slider = Slider(5, range=0..10)
ilineartetraprism = ILinearTetraPrism(
    MinimumSize=number_slider,
    MaximunSize=number_slider,
    CurvatureAdapt=False,
    MinimumElements=6,
    Optimization=0,
    QualityType=2,
    QualityThreshold=0.3,
    Massive_Refinement=False)
debrep = DeconstructBrep(Brep=brep)  # -> Faces, Edges, Vertices
ifillbrep = IFillBrep(Brep=brep, ISettings=ilineartetraprism)  # -> IMesh, Entities, Info
item = ListItem(List=debrep.Faces, Index=Slider(3, range=0..5), Wrap=True)
item_2 = ListItem(List=debrep.Faces, Index=Slider(5, range=0..5), Wrap=True)
item_3 = ListItem(List=debrep.Faces, Index=Slider(1, range=0..5), Wrap=True)
lefi = LeMeshFromIMesh(Header="Cantilever", IMesh=ifillbrep.IMesh)  # -> LeMesh, Mesh
panel = Panel(lefi.LeMesh)
conlemat = ConstructLeMaterial(Name="steel", Density="1", YoungsModulus="205000", PoissonRatio="0.3", TargetEGroup="EGRP1")
congrpsurf = GroupFromSurface(Name="Fix", LeMesh=lefi.LeMesh, Surface=item, GroupType=Slider(0, range=0..2), Tolerance=1e-06)  # -> Group, Geometry
congrpsurf_2 = GroupFromSurface(Name="Load", LeMesh=lefi.LeMesh, Surface=item_2, GroupType=Slider(0, range=0..2), Tolerance=1e-06)  # -> Group, Geometry
congrpsurf_3 = GroupFromSurface(Name="SGRP1", LeMesh=lefi.LeMesh, Surface=item_3, GroupType=Slider(2, range=0..2), Tolerance=1e-06)  # -> Group, Geometry
grpentire = GroupEntireLeMesh(Name="EGRP1", LeMesh=lefi.LeMesh)
conlecnt = ConstructLeControl()
conleasm = LeAssembleModel(
    LeMesh=lefi.LeMesh,
    LeGrp=flatten([congrpsurf.Group, grpentire, congrpsurf_2.Group, congrpsurf_3.Group]),
    LeMat=conlemat,
    LeCnt=conlecnt)
previn = PreviewInput(LeAssemble=conleasm)  # -> Msh, Control, Hec; disabled
path = FilePath("C:\Users\hiroa\Desktop\lemur_test\")
leexe = LeExecute(LeAssemble=conleasm, Thread="-1", Dir=path, Run=Toggle(True))
panel_2 = Panel(conleasm)
panel_3 = Panel(previn.Control)
panel_4 = Panel(previn.Msh)
